% Simulink data dictionary Highway_Assistant.sldd

Highway_Display_Mode_1 = Simulink.Signal(DataType="uint8", Min=0, Max=255)
Highway_Display_Mode_2 = Simulink.Signal(DataType="uint8", Min=0, Max=255)
Highway_Display_Mode_3 = Simulink.Signal(DataType="uint8", Min=0, Max=255)
Highway_Display_Mode_4 = Simulink.Signal(DataType="uint8", Min=0, Max=255)
Lane_Display_Mode_1 = Simulink.Signal(DataType="uint8", Min=0, Max=255)
Lane_Display_Mode_2 = Simulink.Signal(DataType="uint8", Min=0, Max=255)
Lane_Display_Mode_3 = Simulink.Signal(DataType="uint8", Min=0, Max=255)
Lane_Display_Mode_4 = Simulink.Signal(DataType="uint8", Min=0, Max=255)
Highway_Input_Signal = Simulink.Signal(Min=0, Max=255)
Input_Switch = Simulink.Signal(Min=0, Max=255)
Enable_Display = Simulink.Signal(Min=0, Max=255)
Lane_Input_Signal = Simulink.Signal(Min=0, Max=255)
Display_Mode_1 = Simulink.Signal(Min=0, Max=255)
Display_Mode_2 = Simulink.Signal(Min=0, Max=255)
Display_Mode_3 = Simulink.Signal(Min=0, Max=255)
Display_Mode_4 = Simulink.Signal(Min=0, Max=255)